# Grasshopper definition Circle to Helix.gh (Grasshopper 1.0.7)

圆 = GetGeometry(AtLeast=1, AtMost=1, Filter=1073741828)
斜 = GetNumber(AtLeast=1, AtMost=2147483647, Maximum=1.797693135e+308, Minimum=-1.797693135e+308, Prompt="这个为斜率的倒数")
圈 = GetInteger(AtLeast=1, AtMost=1, Maximum=2147483647, Minimum=-2147483648, Prompt="一共有多少圈")
cp = ControlPoints(Curve=圆)  # -> Points, Weights, Knots
num = Number(圆)
division = Division(A=num, B=斜)
lng = ListLength(List=cp.Points)  # -> expr("x - 1", Length)
pdecon = Deconstruct(Point=cp.Points)  # -> XComponent, YComponent, ZComponent
range = Range(Domain=division, Steps=lng)
series = Series(Start=0, Step=division, Count=圈)
multiplication = Multiplication(A=division, B=圈)
addition = Addition(A=range, B=pdecon.ZComponent)
pt = ConstructPoint(XCoordinate=pdecon.XComponent, YCoordinate=pdecon.YComponent, ZCoordinate=addition)
neg = Negative(Value=multiplication)
Z = UnitZ(Factor=neg)
nurbcrv = NurbsCurvePWK(Points=pt, Weights=cp.Weights, Knots=cp.Knots)  # -> Curve, Length, Domain
Z_2 = UnitZ(Factor=series)
move = Move(Geometry=nurbcrv.Curve, Motion=Z_2)  # -> Geometry, Transform

# ---- group: RH_OUT:高度
num_2 = Number(multiplication)

# ----
join = JoinCurves(Curves=move.Geometry, Preserve=False)
move_2 = Move(Geometry=join, Motion=Z)  # -> Geometry, Transform
context_bake = ContextBake(Geometry=move_2.Geometry)
